# Grasshopper definition 1_CreateNgon.gh (Grasshopper 1.0.7)
# plug-ins: NGon 2

# ----
# Create NGon Mesh
# Mesh With Ngons from Polylines
crv = Curve([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])
crv_2 = Curve(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)
crv_3 = Curve([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])
from_polylines = FromPolylines(Polylines=crv, Weld=-1, Min_Triangulation=False)
merge = Merge(Data1=crv_2, Data2=crv_3)
fromph = FromPH(Polylines=merge)

# ----
# Mesh With Ngons from Breps
B = Brep(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)
from_brep = FromBrep(Brep=B, Weld=-1)  # -> Mesh, Polylines
mesh = Mesh(from_brep.Mesh)
clear = Clear(Mesh=mesh)

# ----
# Mesh To Ngon
# Naked edge
# becomes
# Ngon boundary
mesh_2 = Mesh(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)
from_mesh = FromMesh(Mesh=mesh_2, ID=0, It=1000)  # -> Mesh, VertexID, Polylines

# ----
# Get Mesh Ngon Polylines
mesh_3 = Mesh(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)
getpolylines = GetPolylines(Mesh=mesh_3)

# ----
# Display Settings
mesh_4 = Mesh(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)
ngonpreview = NGonPreview(Mesh=mesh_4, Front=ColourSwatch(SwatchColor=RGB(168, 168, 168)), Back=ColourSwatch(SwatchColor=RGB(255, 144, 0)))
