# Grasshopper definition 3_Transformations.gh (Grasshopper 1.0.7)
# plug-ins: NGon 2

# ----
# Extrude Edges By Mesh Normals
toggle = BooleanToggle(True)
# Transformations
mesh = Mesh(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)
extrude_edges = ExtrudeEdges(Mesh=mesh, Dist=Slider(1.04, range=0..10), Cap=toggle, Merge=Toggle(True), BothSides=Toggle(True))

# ----
# NGon Frame
number_slider = Slider(0.66, range=0..1)
mesh_2 = Mesh(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)
ngonframe = NGonFrame(Mesh=mesh_2, Dist=number_slider)  # -> Polylines, Polylines_2, Polylines_3
clean = CleanTree(RemoveNulls=True, RemoveInvalid=True, RemoveEmpty=False, Tree=ngonframe.Polylines_3)
from_polylines = FromPolylines(Polylines=graft(ngonframe.Polylines), Min_Triangulation=False)
from_polylines_2 = FromPolylines(Polylines=clean, Min_Triangulation=False)
from_polylines_3 = FromPolylines(Polylines=ngonframe.Polylines_2, Min_Triangulation=False)

# ----
# Loft 2 sets Closed Polylines WIth Holes
crv = Curve([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])
crv_2 = Curve([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])
crv_3 = Curve(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)
crv_4 = Curve(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)
crv_5 = Curve(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)
crv_6 = Curve([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])
crv_7 = Curve(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)
crv_8 = Curve([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])
merge = Merge(Data1=crv_3, Data2=crv)
merge_2 = Merge(Data1=crv_4, Data2=crv_2)
merge_3 = Merge(Data1=crv_5, Data2=crv_6)
merge_4 = Merge(Data1=crv_7, Data2=crv_8)
entwine = Entwine(Branch00=merge, Branch01=merge_2, FlattenInputs=True)
entwine_2 = Entwine(Branch00=merge_3, Branch01=merge_4, FlattenInputs=True)
item = ListItem(List=entwine_2, Index=0, Wrap=True)
item_2 = ListItem(List=entwine, Index=0, Wrap=True)
loft = LoftPolylines(Polylines=entwine, Polylines_2=entwine_2)
weldmesh = WeldMesh(Mesh=loft, Radius="-3", Align=False, Use_RTree=False)

number_slider_2 = Slider(43, range=0..100)
S = Surface(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)
diamonddivide = DiamondDivide(Surface=S, U=number_slider_2, V=number_slider_2, Boundary=0, Swap=True, Flip=True, Divisions=True, Explode=False)
top = GetPolylines(Mesh=diamonddivide)
fromp = FromPolylines(Curves=graft(top), Min_Triangulation=True)
ngoncenters = NGonCenters(Mesh=fromp)  # -> Centers, Normals, Planes
crv_9 = Curve(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)
crv_cp = CurveClosestPoint(Point=ngoncenters.Centers, Curve=crv_9)  # -> Point, Parameter, flatten(Distance)
bnd = Bounds(Numbers=crv_cp.Distance)
remap = RemapNumbers(Value=crv_cp.Distance, Source=bnd, Target=Domain(0.75, 0))  # -> graft(Mapped), Clipped
ngonframe_2 = NGonFrame(Mesh=simplify(fromp), Dist=simplify(remap.Mapped))  # -> Polylines, Polylines_2, Polylines_3
fromp_2 = FromPolylines(Curves=flatten(ngonframe_2.Polylines), Min_Triangulation=True)
dam = DataDam(DataA=fromp_2, BufferDelay=10000000, BufferMode=0)
offsetmesh = OffsetMesh(Mesh=dam, Dist=Slider(200, range=0..1000), Solid=invert(False))  # disabled
ngonpreview = NGonPreview(Mesh=offsetmesh, LineColor=RGB(0, 0, 0))

# ----
# NGon Mesh Offset By Normals
mesh_3 = Mesh(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)
offsetmesh_2 = OffsetMesh(Mesh=mesh_3, Dist=Slider(-1.57, range=-2..3), Solid=False)

# ----
# Planar Offset works with 3 valuence closed meshes only
# For n>3 valence experimental component
number_slider_3 = Slider(3, range=0..3)
mesh_4 = Mesh(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)
weldmesh_2 = WeldMesh(Mesh=mesh_4, Radius=0.001, Align=False, Use_RTree=False)
offsetplanar = OffsetPlanar(Mesh=weldmesh_2, Dist=number_slider_3)
item_3 = ListItem(List=offsetplanar, Index=0, Wrap=True)  # -> Item, Item1
loft_2 = LoftPolylines(Curve0=item_3.Item, Curve1=item_3.Item1, Fast=invert(True))

# ----
# Curve Loft
crv_10 = Curve(Tree({0}: [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], {1}: [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], {2}: [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], {3}: [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]))
crv_11 = Curve(Tree({0}: [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], {1}: [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], {2}: [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], {3}: [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]))
curveloft = CurveLoft(Curves=[crv_10, crv_11], DivisionsU=10, DivisionsV=0)  # -> Mesh, D
mesh_5 = Mesh(curveloft.Mesh)

# ----
# Offset by distance with chafer corners
number_slider_4 = Slider(0.41, range=0..3)
mesh_6 = Mesh(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)
offsettrianglemesh = OffsetTriangleMesh(Mesh=mesh_6, Dist=number_slider_4, Chamfer=Slider(0.11, range=0..3))  # -> P0, P1, S, P

# ----
# Offset and Project
number_slider_5 = Slider(7, range=0..110)
brep = Brep(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)
quaddivide = QuadDivide(Surface=brep, U=number_slider_5, Rebuild=-1, Divisions=True, Explode=False)
top_2 = GetPolylines(Mesh=quaddivide)
fromp_3 = FromPolylines(Curves=top_2, Min_Triangulation=False)
offsetmeshvda = OffsetMeshVDA(Mesh=fromp_3, Offset=Slider(1.68, range=0.01..2), Type=Slider(1, range=0..1), Dist2=Slider(0.29, range=0.01..1), Tol=0.1)  # -> Mesh, ProjectedPolylines, Thickness, EdgePlanes
crv_12 = Curve(offsetmeshvda.Thickness)

# ----
# Triangle Mesh to Dual NGon Mesh
mesh_7 = Mesh(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)
mesh_8 = Mesh(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)
weldmesh_3 = WeldMesh(Mesh=mesh_8, Radius=0.001, Align=False, Use_RTree=False)
nickname = Dual(Mesh=weldmesh_3, Type=0)

# ----
# Loft curves
crv_13 = Curve([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])
crv_14 = Curve([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])
loft_3 = LoftPolylines(Curve0=graft(crv_13), Curve1=graft(crv_14), Fast=Toggle(False))
crv_15 = Curve(graft([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]))
crv_16 = Curve(graft([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]))
merge_5 = Merge(Data1=crv_15, Data2=crv_16)
loft_4 = LoftPolylines(Curve0=merge_5, Fast=Toggle(False))

ngonpreview_2 = NGonPreview(Mesh=mesh_3)
ngonpreview_3 = NGonPreview(Mesh=extrude_edges, LineColor=RGB(0, 0, 0))
loft_5 = LoftPolylines(Curve0=graft(offsettrianglemesh.P0), Curve1=graft(offsettrianglemesh.P1), Fast=invert(True))
ngonframe_3 = NGonFrame(Mesh=nickname, Dist=0.5)  # -> Polylines, Polylines_2, Polylines_3
fromp_4 = FromPolylines(Curves=ngonframe_3.Polylines, Min_Triangulation=False)
clear = Clear(Mesh=fromp_3)
mjoin = MeshJoin(Meshes=fromp_4)
ngonpreview_4 = NGonPreview(Mesh=loft, LineColor=RGB(0, 0, 0))
clear_2 = Clear(Mesh=mjoin)
from_mesh = FromMesh(Mesh=flatten(clear_2), ID=0, It=1000)  # -> Mesh, VertexID, Polylines
tri = Triangulate(Mesh=clear)  # -> Mesh, Count
mjoin_2 = MeshJoin(Meshes=from_mesh.Mesh)
dual = Dual(Mesh=tri.Mesh, Type=0)
weld = WeldMesh(Mesh=mjoin_2, Radius=0.001, Align=False, Use_RTree=False)
corners = Corners(Mesh=dual)  # -> Corners, ID
ngonpreview_5 = NGonPreview(
    Mesh=weld,
    Front=ColourSwatch(SwatchColor=RGB(255, 0, 0)),
    Back=ColourSwatch(SwatchColor=RGB(255, 255, 255)),
    LineColor=RGB(0, 0, 0))
simplify = Simplify(Mesh=dual, Fixed=corners.Corners)
