# Grasshopper definition 3_Transformations_With_Kangaroo2.gh (Grasshopper 1.0.8)
# plug-ins: Kangaroo2 Components, NGon_RH8

# ----
# Triangulation
mesh = Mesh(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)  # disabled
mesh_2 = Mesh(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)  # disabled
# Tutorials: https://www.learn-visual-programming.com/
# 
# Support: petrasvestartas@gmail.com
# 
# Coffee or Beer : https://ko-fi.com/petrasvestartas
weld = WeldMesh(Mesh=flatten(mesh), Radius=0.001, Align=True, Use_RTree=True)  # disabled
explodemesh = ExplodeMesh(Mesh=weld, Explode=invert(False))  # disabled
demesh = DeconstructMesh(Mesh=explodemesh)  # -> Vertices, Faces, Colours, Normals; disabled
item = ListItem(List=demesh.Vertices, Index=0, Wrap=True)  # -> Item, Item1, Item2, Item3; disabled
srf4pt = _4PointSurface(CornerA=item.Item, CornerB=item.Item1, CornerC=item.Item2, CornerD=item.Item3)  # disabled
number_slider = Slider(1.354, range=0..2)  # disabled
join = BrepJoin(Breps=flatten(srf4pt))  # -> Breps, Closed; disabled
sortbrep = SortBrep(Brep=join.Breps)  # disabled
number_slider_2 = Slider(1.8, range=0.9..2)  # disabled
quaddivide = QuadDivide(Surface=sortbrep, U=number_slider, Rebuild=-1, Divisions=True, Explode=True)  # disabled
diagonal = DiagonalMesh(Mesh=quaddivide)  # disabled
crv = Curve([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])  # disabled
hexdivide = HexDivide(
    Surface=sortbrep,
    U=number_slider_2,
    Parameter=0.25,
    Boundary=0,
    Swap=True,
    Rebuild=-1,
    Quadrangulate=False,
    Divisions=True,
    Explode=True)  # -> Mesh, DistA, DistB; disabled
triangulate = Triangulate(Mesh=diagonal, Curves=crv)  # disabled
dual = Dual(Mesh=triangulate, Type=0)  # disabled
naked = NakedVertices(Mesh=hexdivide.Mesh)  # -> Vertices, Status; disabled

# ----
# Input Geometry:
number_slider_3 = Slider(2.9, range=0.1..11)  # disabled
brep = Brep([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])  # disabled
# Quad Patches
join_2 = BrepJoin(Breps=brep)  # -> Breps, Closed; disabled
sortbrep_2 = SortBrep(Brep=join_2.Breps)  # disabled
quaddivide_2 = QuadDivide(Surface=sortbrep_2, U=number_slider_3, Rebuild=-1, Divisions=True, Explode=False)  # disabled
mesh_3 = Mesh(quaddivide_2)  # disabled

# ----
# Input Geometry:
brep_2 = Brep([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])  # disabled
brep_3 = Brep([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])  # disabled
brep_4 = Brep([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])  # disabled
brep_5 = Brep([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])  # disabled
join_3 = BrepJoin(Breps=brep_5)  # -> Breps, Closed; disabled
number_slider_4 = Slider(0.22, range=0..1)  # disabled
number_slider_5 = Slider(2, range=0..2)  # disabled
sortbrep_3 = SortBrep(Brep=join_3.Breps)  # disabled
hexdivide_2 = HexDivide(
    Surface=sortbrep_3,
    U=number_slider_5,
    Parameter=number_slider_4,
    Boundary=0,
    Swap=True,
    Rebuild=-1,
    Quadrangulate=False,
    Divisions=True,
    Explode=False)  # -> Mesh, DistA, DistB; disabled
mesh_4 = Mesh(hexdivide_2.Mesh)  # disabled

# ---- group: Lift Only Outer Edge
# Kangaroo Goals
demesh_2 = DeconstructMesh(Mesh=mesh_3)  # -> Vertices, Faces, Colours, Normals; disabled
meshedges = MeshEdges(Mesh=mesh_3)  # -> AllE, NakedE; disabled
number_slider_6 = Slider(100, range=0..100)  # disabled
number_slider_7 = Slider(5, range=0.02..12)  # disabled
number_slider_8 = Slider(26.01, range=0..26.01)  # disabled
crv_2 = Curve([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])  # disabled
end = EndPoints(Curve=meshedges.NakedE)  # -> Start, End; disabled
curvecp = CurveCP(Points=[end.Start, end.End], Curve=crv_2, Tol=0.01)  # -> Points, ID; disabled
length_line = LengthLine(Line=flatten(meshedges.AllE), Strength=number_slider_6)  # disabled
anchor = Anchor(Point=curvecp.Points, Strength=10000)  # disabled
sc = SphereCollide(Points=demesh_2.Vertices, Radius=number_slider_7, Strength=1)  # disabled
load = Load(Point=demesh_2.Vertices, ForceVector=Vector(0, 0, 1), Weighting=number_slider_8)  # disabled
show = Show(G=mesh_3)  # disabled

# ----
# Kangaroo Solver
button = Button()  # disabled
toggle = BooleanToggle(True)  # disabled
entwine = Entwine(Branch00=show, Branch01=sc, Branch02=load, Branch03=length_line, Branch04=anchor, FlattenInputs=True)  # disabled
solver = Solver(GoalObjects=entwine, Reset=button, Threshold=1e-15, Tolerance=0.01, On=toggle)  # -> I, V, O; disabled
bang = ExplodeTree(Data=solver.O)  # -> Branch0, Branch1, Branch2, Branch3, Branch4, Branch5; disabled

# ----
# Output
mesh_5 = Mesh(bang.Branch0)  # disabled
triangulate_2 = Triangulate(Mesh=mesh_5)  # disabled
dual_2 = Dual(Mesh=triangulate_2, Type=0)  # disabled

# ----
# Cut Large Polygons
number_slider_9 = Slider(7, range=0..10)  # disabled
number_slider_10 = Slider(10, range=0..80)  # disabled
split3 = Split3(Mesh=dual_2, Size=number_slider_9, Iteration=number_slider_10, Smooth=5)  # disabled
fromp = FromPolylines(Curves=split3, Min_Triangulation=True)  # disabled

# ----
# Book Examples
crv_3 = Curve([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])  # disabled
number_slider_11 = Slider(50, range=0..100)  # disabled
bbox = BoundingBox(Content=crv_3, Plane=PlaneXY(0, 0, 0), UnionBox=True)  # -> Box, Box_2; disabled
crv_4 = Curve(crv_3)  # disabled
rec = Rectangle(bbox.Box)  # disabled
boundary = BoundarySurfaces(Edges=rec)  # disabled
quaddivide_3 = QuadDivide(Surface=boundary, U=number_slider_11, V=number_slider_11, Rebuild=-1, Divisions=True, Explode=True)  # disabled
triangulate_3 = Triangulate(Mesh=quaddivide_3, Curves=crv_4)  # disabled
facesincurves = FacesInCurves(Mesh=triangulate_3, Curves=crv_4)  # disabled
button_2 = Button()  # disabled
toggle_2 = BooleanToggle(False)  # disabled

number_slider_12 = Slider(1, range=0..1)  # disabled
naked_2 = NakedVertices(Mesh=facesincurves)  # -> Vertices, Status; disabled
crv_cp = CurveClosestPoint(Point=naked_2.Vertices, Curve=graft(crv_4))  # -> Point, Parameter, Distance; disabled
smaller = SmallerThan(FirstNumber=crv_cp.Distance, SecondNumber=number_slider_12)  # -> SmallerThan, OrEqualTo; disabled
cull = CullPattern(List=naked_2.Vertices, CullPattern=smaller.SmallerThan)  # disabled

number_slider_13 = Slider(0.4, range=0..1)  # disabled
number_slider_14 = Slider(54, range=0..100)  # disabled
meshedges_2 = MeshEdges(Mesh=facesincurves)  # -> AllE, NakedE; disabled
oncurve = OnCurve(Points=cull, Curve=graft(crv_4), Strength=500)  # disabled
pressure = Pressure(M=facesincurves, Strength=number_slider_13)  # disabled
equallength = EqualLength(Line=meshedges_2.AllE, Strength=10)  # disabled
length_line_2 = LengthLine(Line=meshedges_2.AllE, Length=0, Strength=1)  # disabled
smooth = Smooth(M=facesincurves, Strength=number_slider_14)  # disabled
show_2 = Show(G=facesincurves)  # disabled

solver_2 = Solver(
    GoalObjects=[show_2, oncurve, equallength, length_line_2, pressure, smooth],
    Reset=button_2,
    Threshold=1e-15,
    Tolerance=0.01,
    On=toggle_2)  # -> I, V, O; disabled
item_2 = ListItem(List=solver_2.O, Index=0, Wrap=True)  # disabled

# ---- group: Lift Only Outer Edge
# Kangaroo Goals
medges = MeshEdges(Mesh=mesh_4)  # -> NakedEdges, InteriorEdges, NonManifoldEdges; disabled
crv_5 = Curve([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])  # disabled
number_slider_15 = Slider(11, range=0..100)  # disabled
number_slider_16 = Slider(0.28, range=0..1)  # disabled
number_slider_17 = Slider(100, range=0..100)  # disabled
number_slider_18 = Slider(0.03, range=0.01..1)  # disabled
edges = NGonEdges(Mesh=mesh_4)  # -> AllE, NakedE; disabled
face_edges = NGonFaceEdges(Mesh=mesh_4, TextSize=10, EdgeScale=0.75, Display_Edge_Faces=False, Display_Edges=False, Display_Faces=False)  # -> Edges, ID, FID; disabled
length_line_3 = LengthLine(Line=flatten(edges.AllE), Strength=number_slider_18)  # disabled
length_line_4 = LengthLine(Line=flatten(face_edges.Edges), Strength=number_slider_15)  # disabled
length_line_5 = LengthLine(Line=flatten(medges.InteriorEdges), Strength=number_slider_17)  # disabled
show_3 = Show(G=mesh_4)  # disabled

# ----
# Hex Subdivision Patches
end_2 = EndPoints(Curve=medges.NakedEdges)  # -> Start, End; disabled
curvecp_2 = CurveCP(Points=[end_2.Start, end_2.End], Curve=crv_5, Tol=0.01)  # -> Points, ID; disabled

# ---- group: Lift Only Outer Edge (continued)
anchor_2 = Anchor(Point=curvecp_2.Points, Strength=10000)  # disabled
load_2 = Load(Point=[end_2.Start, end_2.End], ForceVector=Vector(0, 0, 1), Weighting=number_slider_16)  # disabled

# ----
# Kangaroo Solver
entwine_2 = Entwine(Branch00=show_3, Branch02=length_line_3, Branch03=length_line_4, Branch04=load_2, Branch05=anchor_2, FlattenInputs=True)  # disabled
button_3 = Button()  # disabled
toggle_3 = BooleanToggle(True)  # disabled
solver_3 = Solver(GoalObjects=entwine_2, Reset=button_3, Threshold=1e-15, Tolerance=0.01, On=toggle_3)  # -> I, V, O; disabled
bang_2 = ExplodeTree(Data=solver_3.O)  # -> Branch0, Branch1, Branch2, Branch3, Branch4, Branch5; disabled

# ----
# Output
mesh_6 = Mesh(bang_2.Branch0)  # disabled
top = GetPolylines(Mesh=mesh_6)  # disabled
fromp_2 = FromPolylines(Curves=top, Min_Triangulation=True)  # disabled

# ---- group: delete middle points
corners = Corners(Mesh=fromp_2, Angle=135)  # -> Corners, ID; disabled
simplify = Simplify(Mesh=fromp_2, Fixed=corners.Corners)  # disabled

# ----
# Cut Large Polygons
number_slider_19 = Slider(5, range=0..80)  # disabled
number_slider_20 = Slider(10, range=0..100)  # disabled
number_slider_21 = Slider(7, range=0..10)  # disabled
clear = Clear(Mesh=simplify)  # disabled
split3_2 = Split3(Mesh=simplify, Size=number_slider_21, Iteration=number_slider_19, Smooth=number_slider_20)  # disabled
fromp_3 = FromPolylines(Curves=split3_2, Min_Triangulation=False)  # disabled
planar = PlanarFaces(Mesh=fromp_3)  # -> Polylines, Lines; disabled
boundary_2 = BoundarySurfaces(Edges=graft(planar.Polylines))  # disabled
