# Grasshopper definition 6_Edge.gh (Grasshopper 1.0.7)
# plug-ins: NGon 2.1

# ----
# Scale NGons Outlines by Pairs
number_slider = Slider(0.2, range=0..1)
data = Data(Tree({0}: [4, 1], {1}: [5, 2], {2}: [6, 3], {3}: [0, 4], {4}: [1, 5], {5}: [2, 6]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))
mesh = Mesh(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)
sedge = ScaleNGonFaceEdgesByNGonPairs(Mesh=mesh, NGonFacePair=data, Scale=number_slider)  # -> Edges, ID, Flag, Edges_2, Polylines
join = JoinCurves(Curves=sedge.Edges_2, Preserve=False)
preview = CustomPreview(
    Geometry=sedge.Edges,
    Material={diffuse=RGB(255, 0, 0), emission=RGB(66, 48, 66), shine=0.5, specular=RGB(255, 255, 255), transparency=0})
from_polylines = FromPolylines(Polylines=flatten([sedge.Polylines, join]), Min_Triangulation=False)

# ----
# Edges In Ngons
mesh_2 = Mesh(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)
unify = UnifyWindings(Mesh=mesh_2)
face_edges = NGonFaceEdges(
    Mesh=unify,
    TextSize=Slider(0.56, range=0..1),
    EdgeScale=0.75,
    Display_Edge_Faces=False,
    Display_Edges=True,
    Display_Faces=False)  # -> Edges, ID, FID

# ----
# Ngons Connected To Ngon Edges
mesh_3 = Mesh(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)
number_slider_2 = Slider(34, range=0..100)
edges = NGonEdges(Mesh=mesh_3)  # -> Edges, ID, Naked, Normal, Naked_2, AllE
edgengon = NGonsConnectedToNGonEdge(Mesh=mesh_3, Naked=False)  # -> ID, ID_2
getpolylines = GetPolylines(Mesh=mesh_3)
item = ListItem(List=edges.Edges, Index=number_slider_2, Wrap=True)
item_2 = ListItem(List=getpolylines, Index=edgengon.ID, Wrap=True)
preview_2 = CustomPreview(
    Geometry=item,
    Material={diffuse=RGB(255, 0, 0), emission=RGB(66, 48, 66), shine=0.5, specular=RGB(255, 255, 255), transparency=0})
end = EndPoints(Curve=item)  # -> Start, End
branch = TreeBranch(Tree=simplify(item_2), Path=number_slider_2, MaintainPaths=True)

# ----
# All NGon Edges
mesh_4 = Mesh(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)
# Edge
edges_2 = NGonEdges(Mesh=mesh_4)  # -> Edges, ID, Naked, Normal, Naked_2, AllE

# ----
# Find Connected Edges of a Pair NGons
data_2 = Data(Tree({0}: [4, 1], {1}: [5, 2], {2}: [6, 3], {3}: [0, 4], {4}: [1, 5], {5}: [2, 6]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))
mesh_5 = Mesh(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)
edgebyfp = NGonFaceEdgesByNGonPairs(Mesh=mesh_5, NGonFacePair=data_2)  # -> Edges, ID, Flag
preview_3 = CustomPreview(
    Geometry=edgebyfp.Edges,
    Material={diffuse=RGB(255, 0, 0), emission=RGB(66, 48, 66), shine=0.5, specular=RGB(255, 255, 255), transparency=0})
